# Grasshopper definition A3_GraphML_GraphClassification.gh (Grasshopper 1.0.8)

number_slider = Slider(10, range=0..100)

# ----
# Column
column = Curve([<curve referenced from the Rhino model> x175])
unit_z = UnitZ(Factor=number_slider)
extrude = Extrude(Base=column, Direction=unit_z)

number_slider_2 = Slider(10, range=0..10)
unit_z_2 = UnitZ(Factor=number_slider)
addition = Addition(A=number_slider, B=number_slider_2)
unit_z_3 = UnitZ(Factor=addition)
column_2 = Curve([<curve referenced from the Rhino model> x4])
cap_holes = CapHoles(Brep=extrude)

unit_z_4 = UnitZ(Factor=Slider(3, range=0..10))
# Floor
extrude_2 = Extrude(Base=column_2, Direction=expr("-x", unit_z_4))
cap_holes_2 = CapHoles(Brep=extrude_2)

move = Move(Geometry=column_2, Motion=unit_z_2)  # -> Geometry, Transform
unit_z_5 = UnitZ(Factor=number_slider_2)
extrude_3 = Extrude(Base=move.Geometry, Direction=unit_z_5)
cap_holes_3 = CapHoles(Brep=extrude_3)

number_slider_3 = Slider(55, range=0..100)
# Office
curve = Curve(<curve referenced from the Rhino model>)
number_slider_4 = Slider(40, range=0..100)
curve_2 = Curve(<curve referenced from the Rhino model>)
curve_3 = Curve(<curve referenced from the Rhino model>)
curve_4 = Curve(<curve referenced from the Rhino model>)
number_slider_5 = Slider(25, range=0..100)
move_2 = Move(Geometry=curve_2, Motion=unit_z_3)  # -> Geometry, Transform
move_3 = Move(Geometry=curve_3, Motion=unit_z_3)  # -> Geometry, Transform
move_4 = Move(Geometry=curve_4, Motion=unit_z_3)  # -> Geometry, Transform
move_5 = Move(Geometry=curve, Motion=unit_z_3)  # -> Geometry, Transform
unit_z_6 = UnitZ(Factor=Slider(25, range=0..100))
unit_z_7 = UnitZ(Factor=number_slider_4)
unit_z_8 = UnitZ(Factor=number_slider_3)
unit_z_9 = UnitZ(Factor=number_slider_5)
extrude_4 = Extrude(Base=move_2.Geometry, Direction=unit_z_6)
extrude_5 = Extrude(Base=move_3.Geometry, Direction=unit_z_7)
extrude_6 = Extrude(Base=move_4.Geometry, Direction=unit_z_8)
extrude_7 = Extrude(Base=move_5.Geometry, Direction=unit_z_9)
cap_holes_4 = CapHoles(Brep=extrude_4)
cap_holes_5 = CapHoles(Brep=extrude_5)
cap_holes_6 = CapHoles(Brep=extrude_6)
cap_holes_7 = CapHoles(Brep=extrude_7)

addition_2 = Addition(A=addition, B=number_slider_3)

addition_3 = Addition(A=addition, B=number_slider_5)
addition_4 = Addition(A=addition, B=number_slider_4)
unit_z_10 = UnitZ(Factor=addition_2)
# CORE
core = Curve([<curve referenced from the Rhino model> x3])
unit_z_11 = UnitZ(Factor=addition_4)
unit_z_12 = UnitZ(Factor=addition_3)
core_2 = Curve([<curve referenced from the Rhino model> x2])
core_3 = Curve(<curve referenced from the Rhino model>)
extrude_8 = Extrude(Base=core, Direction=unit_z_10)
extrude_9 = Extrude(Base=core_2, Direction=unit_z_11)
extrude_10 = Extrude(Base=core_3, Direction=unit_z_12)

cap_holes_8 = CapHoles(Brep=[extrude_9, extrude_8, extrude_10])
surface = Surface(move_3.Geometry)
surface_2 = Surface(move_4.Geometry)
surface_3 = Surface(move_2.Geometry)
surface_4 = Surface(move_5.Geometry)
number_slider_6 = Slider(5, range=0..10)
series = Series(Start=0, Step=Slider(5, range=0..10), Count=Slider(8, range=0..100))
series_2 = Series(Start=0, Step=Slider(5, range=0..10), Count=Slider(11, range=0..100))
series_3 = Series(Start=0, Step=Slider(5, range=0..10), Count=Slider(5, range=0..100))
series_4 = Series(Start=0, Step=number_slider_6, Count=number_slider_6)
unit_z_13 = UnitZ(Factor=series)
unit_z_14 = UnitZ(Factor=series_2)
unit_z_15 = UnitZ(Factor=series_3)
unit_z_16 = UnitZ(Factor=series_4)
move_6 = Move(Geometry=surface, Motion=unit_z_13)  # -> Geometry, Transform
move_7 = Move(Geometry=surface_3, Motion=unit_z_15)  # -> Geometry, Transform
move_8 = Move(Geometry=surface_2, Motion=unit_z_14)  # -> Geometry, Transform
move_9 = Move(Geometry=surface_4, Motion=unit_z_16)  # -> Geometry, Transform
